# Grasshopper definition rhino_full_shader.gh (Grasshopper 1.0.4)
# plug-ins: Shader Nodes

m_shader_basecolor = ColourPicker(PickedColour=RGB(255, 0, 0))

# ---- group: CONSTANTS
black = ColourPicker(PickedColour=RGB(0, 0, 0))
white = ColourPicker(PickedColour=RGB(255, 255, 255))

# ---- group: INPUT: DIFFUSE
m_shader_diffusetexture_invertrepeatasfl = Slider(1, range=0..1)  # "m_shader.DiffuseTexture.InvertRepeatAsFloat"
m_shader_diffusetexture_usealphaasfloat = Slider(0, range=0..1)
m_shader_diffusetexture_amount = Slider(1, range=0..1)
m_shader_shadelessasfloat = Slider(1, range=0..1)

# ---- group: INPUT: REFRACTION / TRANSPARENCY
m_shader_hastransparencytextureasfloat = Slider(0, range=0..1)
m_shader_transparencytexture_amount = Slider(0, range=0..1)
m_shader_refractionroughnesspow2 = Slider(0, range=0..1)
m_shader_transparency = Slider(0, range=0..1)
m_shader_ior = Slider(1.45, range=1..5)

# ---- group: INPUT: REFLECTION
m_shader_reflectionroughnesspow2 = Slider(0, range=0..1)
m_shader_fresnelreflectionsasfloat = Slider(0, range=0..1)
m_shader_reflectivity = Slider(0, range=0..1)
m_shader_fresnelior = Slider(1.45, range=1..5)

# ----
m_shader_environmenttexture_amount = Slider(0, range=0..1)
m_shader_reflectioncolorgamma = ColourPicker(PickedColour=RGB(255, 255, 255))
m_shader_transparencycolorgamma = ColourPicker(PickedColour=RGB(255, 255, 255))
m_shader_emissioncolorgamma = ColourPicker(PickedColour=RGB(255, 255, 255))
m_shader_bumptexture_amount = Slider(1, range=0..1)
texcoord = Texcoord()  # -> Generated, Normal, UV, Object, Camera, Window, Reflection, WcsBox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

# ---- group: DIFFUSE COLOR
invert_transparency = Invert_transparency(Value1=1, Value2=m_shader_transparency, UseClamp=False)
diffuse_texture = Diffuse_texture(
    Vector=texcoord.UV,
    Image="C:\Users\Nathan\Downloads\RH-38509_DiffuseAlphaBug_new_embedded_files\alpha_channel_example.png",
    ImTexColorSpace="None",
    ImTexInterpolation="Smart",
    ImTexProjection="Flat",
    ImTexTextureExtension="Repeat")  # -> Color, Alpha

# ---- group: bump
bump_texture = Bump_texture(
    Vector=texcoord.UV,
    ImTexColorSpace="None",
    ImTexInterpolation="Smart",
    ImTexProjection="Flat",
    ImTexTextureExtension="Repeat")  # -> Color, Alpha
bump_texture_to_bw = Bump_texture_to_bw(Color=bump_texture.Color)
bump_amount = Bump_amount(Value1=Slider(4.66, range=0..10), Value2=m_shader_bumptexture_amount, UseClamp=False)
bump = Bump(Height=bump_texture_to_bw, Normal=Vector(0, 0, 0), Strength=bump_amount, Distance=0.1)

# ---- group: diffuse alpha
weight_diffuse_amount_by_transparency_in = Weight_diffuse_amount_by_transparency_inv(Value1=m_shader_diffusetexture_amount, Value2=invert_transparency, UseClamp=False)
invert_alpha = Invert_alpha(Value1=1, Value2=diffuse_texture.Alpha, UseClamp=False)
diffuse_texture_alpha_amount = Multiply(Value1=diffuse_texture.Alpha, Value2=m_shader_diffusetexture_amount, UseClamp=False)
diff_tex_alpha_multiplied_with_inv_trans = Multiply(Value1=diffuse_texture_alpha_amount, Value2=invert_transparency, UseClamp=False)  # "diff_tex_alpha_multiplied_with_inv_transparency"
diffuse_base_color_through_alpha = Mix(Color1=m_shader_basecolor, Color2=diffuse_texture.Color, Fac=diff_tex_alpha_multiplied_with_inv_trans, Blend="Mix")

# ---- group: REFLECTION FACTOR
fresnel_based_on_constant = Fresnel_based_on_constant(IOR=m_shader_fresnelior, Normal=bump)
fresnel_reflection_if_reflection_used = Fresnel_reflection_if_reflection_used(Value1=m_shader_reflectivity, Value2=m_shader_fresnelreflectionsasfloat, UseClamp=False)
simple_reflection = Simple_reflection(R=m_shader_reflectivity, G=0, B=0)
fresnel_reflection = Fresnel_reflection(R=fresnel_based_on_constant, G=0, B=0)
select_reflection_or_fresnel_reflection = Select_reflection_or_fresnel_reflection(Color1=simple_reflection, Color2=fresnel_reflection, Fac=fresnel_reflection_if_reflection_used, Blend="Mix")
reflection_factor = Reflection_factor(Image=select_reflection_or_fresnel_reflection)  # -> R, G, B

# ---- group: EMISSION COLOR COMPONENT
separate_emission_color = SeparateRGB(Image=m_shader_emissioncolorgamma)  # -> R, G, B
emission_color_strength = Color2Luminance(Color=m_shader_emissioncolorgamma)

# ----
light_path = Light_path()  # -> IsCameraRay, IsShadowRay, IsDiffuseRay, IsGlossyRay, IsSingularRay, IsReflectionRay, IsTransmissionRay, IsVolumeScatterRay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

# ---- group: DIFFUSE + EMISSION
diffuse_for_emission_separation = SeparateRGB(Image=diffuse_base_color_through_alpha)  # -> R, G, B
diffuse_plus_emission_b = Add(Value1=diffuse_for_emission_separation.B, Value2=separate_emission_color.B, UseClamp=True)
diffuse_plus_emission_g = Add(Value1=diffuse_for_emission_separation.G, Value2=separate_emission_color.G, UseClamp=True)
diffuse_plus_emission_r = Add(Value1=diffuse_for_emission_separation.R, Value2=separate_emission_color.R, UseClamp=True)
final_diffuse_with_emission = CombineRGB(R=diffuse_plus_emission_r, G=diffuse_plus_emission_g, B=diffuse_plus_emission_b)

# ----
# Add emission color to shadeless strength.
# 
# If shadeless is 0 (i.e. not self-illuminating) we use strength of emission color to chose a factor between shaded and shadeless
shadeless_as_float_plus_emission_color_s = Add(Value1=m_shader_shadelessasfloat, Value2=emission_color_strength, UseClamp=True)  # "shadeless_as_float_plus_emission_color_strength"

# ---- group: REFLECTION COMPONENT
attenuated_reflection_color = Attenuated_reflection_color(Color1=black, Color2=m_shader_reflectioncolorgamma, Fac=m_shader_reflectivity, Blend="Mix")
glossy = Glossy(Color=attenuated_reflection_color, Roughness=m_shader_reflectionroughnesspow2, Normal=bump, Distribution="GGX")

# ---- group: DIFFUSE COMPONENT
# shadeless only from camera ray.
final_diffuse = Diffuse(Color=final_diffuse_with_emission, Roughness=0, Normal=bump)
shadeless_bsdf = Shadeless_bsdf(Color=final_diffuse_with_emission, Strength=1)
shadeless_on_cameraray = Multiply(Value1=light_path.IsCameraRay, Value2=shadeless_as_float_plus_emission_color_s, UseClamp=False)
shadeless = Shadeless(Closure1=final_diffuse, Closure2=shadeless_bsdf, Fac=shadeless_on_cameraray)

# ---- group: ENVMAP COMPONENT / envmap vector fix
separate_envmap_texco = Separate_xyz(Vector=texcoord.EnvEmap)  # -> X, Y, Z
flip_sign_envmap_texco_y = Multiply(Value1=separate_envmap_texco.Y, Value2=-1, UseClamp=False)
recombine_envmap_texco = Combine_xyz(X=separate_envmap_texco.X, Y=flip_sign_envmap_texco_y, Z=separate_envmap_texco.Z)

# ---- group: REFRACTION COMPONENT
attennuated_refraction_color = Attennuated_refraction_color(Color1=black, Color2=m_shader_transparencycolorgamma, Fac=m_shader_transparency, Blend="Mix")
refraction = Refraction(
    Color=attennuated_refraction_color,
    Roughness=m_shader_refractionroughnesspow2,
    IOR=m_shader_ior,
    Normal=bump,
    Distribution="GGX")

# ---- group: ENVMAP COMPONENT
environment_texture = Environment_texture(
    Vector=recombine_envmap_texco,
    ImTexColorSpace="None",
    ImTexInterpolation="Smart",
    ImTexProjection="Flat",
    ImTexTextureExtension="Repeat")  # -> Color, Alpha
attenuated_environment_color = Attenuated_environment_color(Color1=black, Color2=environment_texture.Color, Fac=m_shader_environmenttexture_amount, Blend="Mix")
environment_map_diffuse = Diffuse(Color=attenuated_environment_color, Roughness=0, Normal=Vector(0, 0, 0))

# ---- group: determine shadow ray
invert_roughness = Invert_roughness(Value1=1, Value2=m_shader_refractionroughnesspow2, UseClamp=False)
multiply_transparency = Multiply_transparency(Value1=invert_roughness, Value2=m_shader_transparency, UseClamp=False)
multiply_with_shadowray = Multiply_with_shadowray(Value1=multiply_transparency, Value2=light_path.IsShadowRay, UseClamp=False)
weight_for_shadowray_coloured_shadow = Weight_for_shadowray_coloured_shadow(Value1=multiply_with_shadowray, Value2=1, UseClamp=False)

# ----
# Combine the diffuse and glossy components.
diffuse_plus_glossy = Diffuse_plus_glossy(Closure1=shadeless, Closure2=glossy, Fac=reflection_factor.R)

# ----
# Combine the diffuse+glossy with transparency
blend_in_transparency = Blend_in_transparency(Closure1=shadeless, Closure2=refraction, Fac=m_shader_transparency)
diffuse_glossy_and_refraction = Diffuse_glossy_and_refraction(Closure1=diffuse_plus_glossy, Closure2=blend_in_transparency, Fac=m_shader_transparency)

# ---- group: TRANSPARENCY FACTOR FOR CUTOUT
transparency_texture = Transparency_texture(
    Vector=texcoord.UV,
    ImTexColorSpace="None",
    ImTexInterpolation="Smart",
    ImTexProjection="Flat",
    ImTexTextureExtension="Repeat")  # -> Color, Alpha
transpluminance = Transpluminance(Color=transparency_texture.Color)
invert_luminence = Invert_luminence(Value1=1, Value2=transpluminance, UseClamp=False)
transparency_texture_amount = Transparency_texture_amount(Value1=invert_luminence, Value2=m_shader_transparencytexture_amount, UseClamp=False)
toggle_transparency_texture = Toggle_transparency_texture(Value1=m_shader_hastransparencytextureasfloat, Value2=transparency_texture_amount, UseClamp=False)
toggle_diffuse_texture_alpha_usage = Toggle_diffuse_texture_alpha_usage(Value1=invert_alpha, Value2=m_shader_diffusetexture_usealphaasfloat, UseClamp=False)
add_diffuse_texture_alpha = Add_diffuse_texture_alpha(Value1=toggle_diffuse_texture_alpha_usage, Value2=toggle_transparency_texture, UseClamp=False)

# ----
# add the env mapping texture
custom_environment_blend = Custom_environment_blend(Closure1=diffuse_glossy_and_refraction, Closure2=environment_map_diffuse, Fac=m_shader_environmenttexture_amount)

# ---- group: shadow color
coloured_shadow_trans_color = Coloured_shadow_trans_color(Color=diffuse_base_color_through_alpha)

# ---- group: GLASS FLOW
principledbsdf = Principledbsdf(
    BaseColor=m_shader_basecolor,
    Subsurface=0,
    SubsurfaceRadius=Vector(0, 0, 0),
    SubsurfaceColor=RGB(128, 128, 128),
    Metallic=0,
    Specular=0,
    SpecularTint=0,
    Roughness=m_shader_reflectionroughnesspow2,
    Anisotropic=0,
    AnisotropicRotation=0,
    Sheen=0,
    SheenTint=0,
    Clearcoat=0,
    ClearcoatGloss=0,
    IOR=m_shader_ior,
    Transmission=m_shader_transparency,
    TransmissionRoughness=m_shader_refractionroughnesspow2,
    Normal=bump,
    ClearcoatNormal=bump,
    Tangent=Vector(0, 0, 0))
coloured_shadow_mix_glass_principled = Coloured_shadow_mix_glass_principled(Closure1=principledbsdf, Closure2=coloured_shadow_trans_color, Fac=weight_for_shadowray_coloured_shadow)

# ----
# Here we color the shadow
coloured_shadow_mix_custom = Coloured_shadow_mix_custom(Closure1=custom_environment_blend, Closure2=coloured_shadow_trans_color, Fac=weight_for_shadowray_coloured_shadow)

# ----
# Apply any transparency texture effects. This is where "cutouts" happen.
transparent = Transparent(Color=white)
custom_alpha_cutter = Custom_alpha_cutter(Closure1=coloured_shadow_mix_custom, Closure2=transparent, Fac=add_diffuse_texture_alpha)

# ---- group: DEBUGGER
# Debugger. Use to view intermediate steps of shader.
combine_rgb = CombineRGB(R=diffuse_plus_emission_r, G=diffuse_plus_emission_g, B=diffuse_plus_emission_b)
diffuse_bsdf = DiffuseBSDF(Color=combine_rgb, Roughness=0, Normal=Vector(0, 0, 0))
output = Output(Surface=custom_alpha_cutter, Volume=RGB(128, 128, 128), Displacement=0)

# ----
output_2 = Output(Surface=[custom_alpha_cutter, coloured_shadow_mix_glass_principled], Volume=RGB(128, 128, 128), Displacement=0)
text_join = TextJoin(Text=output_2)
ghpython_script = GhPythonScript(code=text_join, csharp_indent=Slider(3, range=0..10))  # -> out, csharp, xml; inputs csharp_indent: Int32
# ---------- ghpython_script: Python ----------
"""Provides a scripting component.
    Inputs:
        code: The input code as a string
    Output:
        out: Debug output
        csharp: C# code
        xml: XML code"""

__author__ = "Nathan"

import rhinoscriptsyntax as rs
import string
import re

lines = code.split("\n")

if not csharp_indent: csharp_indent = 0

lines_seen = list()

cleanedcsharp_nodes    = list()
cleanedcsharp_adds     = list()
cleanedcsharp_connects = list()

cleanedxml = list()

whitespace_start = re.compile("^(\s+)", re.S)
whitespace_var = re.compile("^(\s*var)", re.S)
var_start = re.compile("^(var).*", re.S)
novar_start = re.compile("^(?!var).*", re.S)
diffuse_texture_repeat = re.compile("^(\s*diffuse_texture)([0-9]+)(\.Extension.*)(Repeat);", re.S)

indentfix = re.compile(csharp_indent*"\t"+"\nvar", re.S)

for line in lines:
    strline = string.strip(line)
    if strline in lines_seen: continue
    lines_seen.append(strline)
    if line in cleanedcsharp_nodes or line in cleanedcsharp_adds or line in cleanedcsharp_connects or line in cleanedxml:
            continue
    if len(line) < 1: continue
    if line[0] == "-": continue
    if len(line)>1 and line[0] == "<" and line[1] == "!": continue
    if line[0] == "<":
        cleanedxml.append(line)
    else:
        if string.find(line, "(output.") > -1:
            continue
            
        if string.find(line, ".AddNode(") > -1:
            cleanedcsharp_adds.append(line)
        elif string.find(line, ".Connect(") > -1:
            cleanedcsharp_connects.append(line)
        else:
            cleanedcsharp_nodes.append(line)
            
            

intermcleanedcsharp_nodes = list()

for line in cleanedcsharp_nodes:
    nvs = re.search(novar_start, line)
    if nvs: line = "\t" + line
    line = re.sub(whitespace_start, "\t", line)
    line = re.sub(whitespace_var, "\nvar", line)
    
    line = re.sub(diffuse_texture_repeat, r'\1\2\3part.DiffuseTexture.Repeat ? TextureNode.TextureExtension.Repeat : TextureNode.TextureExtension.Clip;', line)

    if string.find(line, "var") == 0: line = "\n" + line
    
    intermcleanedcsharp_nodes.append(line)

cleanedcsharp = intermcleanedcsharp_nodes + ["\n"] + cleanedcsharp_adds + ["\n"] + cleanedcsharp_connects

joinstr = "\n" + csharp_indent * "\t"

intermcsharp = joinstr.join(cleanedcsharp[1:])
intermcsharp = string.replace(intermcsharp, "\r", "")
intermcsharp = string.replace(intermcsharp, "m_shader.", "part.")
intermcsharp = string.replace(intermcsharp, "new part", "part")
intermcsharp = string.replace(intermcsharp, "True;", "true;")
intermcsharp = string.replace(intermcsharp, "False;", "false;")
intermcsharp = string.replace(intermcsharp, "shader.AddNode", "m_shader.AddNode")
intermcsharp = string.replace(intermcsharp, " Repeat;", " TextureNode.TextureExtension.Repeat;")
intermcsharp = string.replace(intermcsharp, " Flat;", " TextureNode.TextureProjection.Flat;")
intermcsharp = string.replace(intermcsharp, " None;", " TextureNode.TextureColorSpace.None;")
intermcsharp = string.replace(intermcsharp, " Smart;", " InterpolationType.Smart;")
intermcsharp = string.replace(intermcsharp, "\n\n\n", "\n\n")
intermcsharp = string.strip(intermcsharp)

if csharp_indent > 0:
    intermcsharp = re.sub(indentfix, "\n" + csharp_indent*"\t" + "var" , intermcsharp)

csharp = csharp_indent*"\t" + intermcsharp

xml = "\n".join(cleanedxml)
# ---------- end ghpython_script ----------
panel = Panel(ghpython_script.csharp)
